# Dynamo graph set areas usage type by csv.dyn (Dynamo 2.19.3.6394)
# packages: GenerativeDesign.Revit 6.1.3.0, archi-lab.net 2024.217.1024

select_multiple_model_elements = DSModelElementMutlipleSelection()  # 46 picked in the model
location = archilab.Revit.Elements.Elements.Location(element=select_multiple_model_elements)
Y = Point.Y(point=location.Point)
sortByKey = List.SortByKey(list=select_multiple_model_elements, keys=Y)
reverse = List.Reverse(list=sortByKey.sortedList)
string = StringInput("Usage Type")
file_path = Filename("..\pyArea.tab\lib\UsageType_CommonGross.csv")
importCSV = Data.ImportCSV(filePath=file_path)
code_block = CodeBlock(a=importCSV) { a[0]; }
deconstruct = List.Deconstruct(list=code_block)
string_from_object = FromObject(object=deconstruct.rest)
setParameterByName = Element.SetParameterByName(element=reverse, parameterName=string, value=string_from_object)
string_2 = StringInput("Name")
code_block_2 = CodeBlock(a=importCSV) { a[1]; }
deconstruct_2 = List.Deconstruct(list=code_block_2)
setParameterByName_2 = Element.SetParameterByName(element=reverse, parameterName=string_2, value=deconstruct_2.rest)
